# Grasshopper definition poc-client.gh (Grasshopper 1.0.8)
# plug-ins: RhinoCodePluginGH

script = Script()  # -> out, a; disabled
# ---------- script: Python ----------
import getpass
import os
import pwd

# Method 1: getpass (most reliable)
user1 = getpass.getuser()

# Method 2: environment variable
user2 = os.environ.get('USER')  # or 'USERNAME' on Windows

# Method 3: pwd database (Unix-like systems only)
user3 = pwd.getpwuid(os.getuid()).pw_name

print(f"Username from getpass: {user1}")
print(f"Username from env: {user2}")
print(f"Username from pwd: {user3}")
# ---------- end script ----------
compas_eve = Script(mqtt_broker="localhost", reset=Button(), on=Toggle(False))  # -> last_message
# ---------- compas_eve: Python ----------
# r: compas_eve
# venv: aec_hackathon_2025


import System
import Rhino
import Grasshopper
import rhinoscriptsyntax as rs

import functools
import time

from compas_eve import Message
from compas_eve import Topic
from compas_eve import Subscriber
from compas_eve.mqtt import MqttTransport
from compas_eve.ghpython import BackgroundWorker

def start_server(worker, mqtt_broker):
    topic_name = "ifc/IfcWall"

    def handle_message(message):
        worker.display_message("Entity received.".format(message))
        worker.update_result(message, 10)

    tx = MqttTransport(mqtt_broker)
    topic = Topic(topic_name)
    worker.subscriber = Subscriber(topic, callback=handle_message, transport=tx)
    worker.subscriber.subscribe()
    worker.display_message("Subscribed")

def stop_server(worker):
    if hasattr(worker, "subscriber"):
        worker.subscriber.unsubscribe()
    worker.display_message("Stopped")
    

class IfcDataBusComponent(Grasshopper.Kernel.GH_ScriptInstance):
    def RunScript(self, mqtt_broker, reset, on):
        if not on:
            BackgroundWorker.stop_instance_by_component(ghenv)  # noqa: F821
            return None

        self.worker = BackgroundWorker.instance_by_component(ghenv, start_server, dispose_function=stop_server, force_new=reset, auto_set_done=False, args=(mqtt_broker,))  # noqa: F821

        if not self.worker.is_working() and not self.worker.is_done() and reset:
            self.worker.start_work()

        print("Worker ID: {}".format(id(self.worker)))
        print("Is worker running? {}".format(self.worker.is_working()))
        print("Worker completed? {}".format(self.worker.is_done()))
        if hasattr(self.worker, "thread"):
            print("Worker thread: {}".format(self.worker.thread))

        if hasattr(self.worker, "result"):
            return self.worker.result
        else:
            return None
# ---------- end compas_eve ----------
script_2 = Script()  # -> out, box; disabled
# ---------- script_2: Python ----------
"""Example demonstrating conversion of IFC geometry to COMPAS geometry."""

from compas.geometry import Point, Vector, Frame, Box
from compas.geometry import Translation, Rotation


def create_extruded_solid(ifc_data):
    """Create COMPAS geometry from IFC extruded area solid data."""
    # Extract profile dimensions (converting from mm to m)
    width = ifc_data["sweptArea"]["xDim"] / 1000.0  # 5.0m
    thickness = ifc_data["sweptArea"]["yDim"] / 1000.0  # 0.27m
    height = ifc_data["depth"] / 1000.0  # 3.0m
    
    # Get position data
    position = ifc_data["sweptArea"]["position"]
    location = position["location"]["coordinates"]
    ref_direction = position["refDirection"]["directionRatios"]
    
    # Create base point and direction vectors
    base_point = Point(location[0], location[1], 0)
    x_dir = Vector(ref_direction[0], ref_direction[1], 0)
    extrusion_dir = Vector(
        ifc_data["extrudedDirection"]["directionRatios"][0],
        ifc_data["extrudedDirection"]["directionRatios"][1],    
        ifc_data["extrudedDirection"]["directionRatios"][2],
    )
    
    # Create frame for the box
    # Z direction is the extrusion direction
    # X direction is from the profile's reference direction
    # Y direction is the cross product
    z_axis = extrusion_dir
    x_axis = x_dir
    y_axis = z_axis.cross(x_axis)
    
    frame = Frame(base_point, x_axis, y_axis)
    
    # Create box with dimensions
    # Note: In COMPAS, Box is centered on the frame
    # So we need to translate it to match IFC convention (base corner at origin)
    box = Box(width, thickness, height, frame)
    
    # Move box so its base corner is at the origin
    T = Translation.from_vector([width/2, thickness/2, height/2])
    box.transform(T)
    
    return box


# Example IFC data
ifc_data = {
    "type": "IfcExtrudedAreaSolid",
    "sweptArea": {
        "type": "IfcRectangleProfileDef",
        "profileType": "AREA",
        "xDim": 5000.0,  # mm
        "yDim": 270.0,   # mm
        "position": {
            "type": "IfcAxis2Placement2D",
            "location": {
                "type": "IfcCartesianPoint",
                "coordinates": [0.0, 0.0]
            },
            "refDirection": {
                "type": "IfcDirection",
                "directionRatios": [1.0, 0.0]
            }
        }
    },
    "extrudedDirection": {
        "type": "IfcDirection",
        "directionRatios": [0.0, 0.0, 1.0]
    },
    "depth": 3000.0  # mm
}

# Create box
box = create_extruded_solid(ifc_data)
print("Created COMPAS Box:")
print(f"Frame: {box.frame}")
print(f"Dimensions: {box.xsize}m x {box.ysize}m x {box.zsize}m")

# You can visualize this with:
# from compas_viewer.viewer import Viewer
# viewer = Viewer()
# viewer.add(box)
# viewer.show()
# ---------- end script_2 ----------
compas_draw = COMPASDraw(cg=script_2.box)  # -> rg; disabled
#   port cg: The COMPAS geometry or datastructure to be drawn.
#   port rg: The Rhino geometry object.
# ---------- compas_draw: Python ----------
# r: compas>=2.8.1
"""
Draws COMPAS geometry in Grasshopper.
"""

from typing import Any

import Grasshopper

from compas.scene import SceneObject


class CompasToRhinoGeometry(Grasshopper.Kernel.GH_ScriptInstance):
    def RunScript(self, cg):
        if not cg:
            return None

        return SceneObject(item=cg).draw()
# ---------- end compas_draw ----------

# ----
# Preview walls in the model
message = Data(compas_eve)
filter_walls = Script(message=message)  # -> walls
# ---------- filter_walls: Python ----------
"""Grasshopper Script Instance"""
import System
import Rhino
import Grasshopper

import rhinoscriptsyntax as rs

import scriptcontext as sc

class MyComponent(Grasshopper.Kernel.GH_ScriptInstance):
    def RunScript(self, message):
        ifc_bus_storage = sc.sticky.get("ifc_bus_storage")
        if not ifc_bus_storage:
            ifc_bus_storage = {}
        sc.sticky["ifc_bus_storage"] = ifc_bus_storage

        if message:
            ifc_bus_storage[message["id"]] = message.__dict__["data"]
            #message["data"]

        ghenv.Component.Message = f"Active entities={len(ifc_bus_storage.keys())}"
        walls = []
        for entity_id, entity in ifc_bus_storage.items():
            if entity['entity_type'] == "IfcWall":
                walls.append(entity_id)

        return walls
# ---------- end filter_walls ----------
wall = Script(walls=filter_walls, i=Slider(0, range=0..10))  # -> global_id; inputs walls: list, i: Int32
# ---------- wall: Python ----------
global_id = walls[i]
# ---------- end wall ----------

# ----
# COMPAS Geometry preview
wall_editor = Script(global_id=wall)  # -> result
# ---------- wall_editor: Python ----------
import scriptcontext as sc
from compas.datastructures import Mesh
import json


ifc_bus_storage = sc.sticky.get("ifc_bus_storage")
ifc_entity = ifc_bus_storage[global_id]

def get_mesh_from_tessellation(data):
    if data["type"] != "IfcTriangulatedFaceSet":
        raise ValueError("Nope")

    vertices = data["coordinates"]["coordList"]
    faces = data["coordIndex"]
    return Mesh.from_vertices_and_faces(vertices, faces)


result = []
if ifc_entity["entity_type"] == "IfcWall":
    representation = ifc_entity["data"]["representation"]
    import ast
    # Emmm... sorry about this..hackathon mode ;)
    representation = ast.literal_eval(representation)

    if representation["type"] == "IfcProductDefinitionShape":
        for reprs in representation["representations"]:
            if reprs["type"] == "IfcShapeRepresentation" and reprs["representationType"] == "Tessellation":
                for item in reprs["items"]:
                    mesh = get_mesh_from_tessellation(item)
                    result.append(mesh)
# ---------- end wall_editor ----------
compas_draw_2 = COMPASDraw(cg=wall_editor)  # -> rg; same code as compas_draw

# ----
# Incoming messages preview
panel = Panel(compas_eve)
